# Dynamo graph ExtractFamilyDataFromDirectory.dyn (Dynamo 2.3.0.5885)

python_script = Python()  # frozen; unwired: IN[0]
# ---------- python_script.python (105 lines) ----------
import clr
clr.AddReference('ProtoGeometry')
from Autodesk.DesignScript.Geometry import *

# Import DocumentManager and TransactionManager
clr.AddReference("RevitServices")
import RevitServices
from RevitServices.Persistence import DocumentManager
from RevitServices.Transactions import TransactionManager

# Import python library
import sys
pyt_path = r'C:\Program Files (x86)\IronPython 2.7\Lib'
sys.path.append(pyt_path)
import os

doc = DocumentManager.Instance.CurrentDBDocument
uiapp = DocumentManager.Instance.CurrentUIApplication
app = uiapp.Application

def flatten(*args):
	for x in args:
		if hasattr(x, '__iter__'):
			for y in flatten(*x): yield y
		else: yield x


#Credits Archi-lab
def checkParameter(param):
	for p in param:
		internal = p.Definition
		if internal.BuiltInParameter != BuiltInParameter.INVALID:
			return p
	return param[0]

def GetParaValue(params):
	paravalue = []
	p = checkParameter(params)
	if p.StorageType == StorageType.String:
		paravalue.append(p.AsString())
	elif p.StorageType == StorageType.ElementId:
		paravalue.append(p.AsValueString())
	elif p.StorageType == StorageType.Integer:
		paravalue.append(p.AsValueString())
	else:
		paravalue.append(None)
	return paravalue

# Import RevitAPI
clr.AddReference("RevitAPI")
import Autodesk
from Autodesk.Revit.DB import *

clr.AddReference("RevitNodes")
import Revit
clr.ImportExtensions(Revit.Elements)

if isinstance(IN[0], list):
	files = IN[0]
else:
	files = [IN[0]]

version = "v" + app.VersionNumber

options = OpenOptions()
options.DetachFromCentralOption = DetachFromCentralOption.DetachAndPreserveWorksets

worksharingOptions = WorksharingSaveAsOptions()
worksharingOptions.SaveAsCentral = True

SaveOptions = SaveAsOptions()
SaveOptions.SetWorksharingOptions(worksharingOptions)
SaveOptions.OverwriteExistingFile = True

LinkNames, newdocpath, results, unloadstatus, linkParas = [], [], [], [], []

#revitlinktypes=list()
#linkcollector=FilteredElementCollector(doc).OfClass(RevitLinkInstance)
#revitlinktypes=[]
TransactionManager.Instance.ForceCloseTransaction()

try:
	for file in files:
		modelpath = FilePath(file)
		newdoc = app.OpenDocumentFile(modelpath,options)
	
		collector = Autodesk.Revit.DB.FilteredElementCollector(newdoc)
		linkTypes = UnwrapElement(collector.OfClass(Autodesk.Revit.DB.RevitLinkType))
		for linkType in flatten(linkTypes):
			linkPara = linkType.GetParameters("Type Name")
			linkParavalue = GetParaValue(linkPara)
			try:
				linkType.Unload(None)
				unloadstatus.append(True)
			except:
				unloadstatus.append(False)
			results = [unloadstatus]
except Exception,e:	
	
	
	newfile = file
	newdoc.SaveAs(newfile,SaveOptions)
	newdoc.Close(False)

OUT = 0
# ----------------------------------------
input_rfa_families = Directory("D:\Xavier\SUMMONIDEA\BLOGGING\summon-family-browser\src\input_families")  # graph input
fromPath = DirectoryObject(path=input_rfa_families)  # "Directory.FromPath"
code_block = CodeBlock { "*.rfa"; }
boolean = BoolSelector(true)
getDirectoryContents = FileSystem.GetDirectoryContents(directory=fromPath, searchString=code_block, includeSubdirectories=boolean)
string_from_object = FromObject(obj=getDirectoryContents.files)
flatten = List.Flatten(list=string_from_object)
python_script_2 = Python(IN[0]=flatten, IN[1]=input_rfa_families)  # frozen; unwired: IN[2]
# ---------- python_script_2.python (131 lines) ----------
import clr
clr.AddReference('ProtoGeometry')
from Autodesk.DesignScript.Geometry import *

# Import RevitAPI
clr.AddReference("RevitAPI")
import Autodesk
from Autodesk.Revit.DB import *
from Autodesk.Revit.Attributes import*

import clr
clr.AddReference("RevitAPIUI")
from  Autodesk.Revit.UI import *

# Import DocumentManager and TransactionManager
clr.AddReference("RevitServices")
import RevitServices
from RevitServices.Persistence import DocumentManager
from RevitServices.Transactions import TransactionManager

from System.Collections.Generic import *

# Import Revit Nodes
clr.AddReference("RevitNodes")
import Revit
clr.ImportExtensions(Revit.Elements)
clr.ImportExtensions(Revit.GeometryConversion)

# Import python library
import sys
pyt_path = r'C:\Program Files (x86)\IronPython 2.7\Lib'
sys.path.append(pyt_path)
import os

tOptions = TransactWithCentralOptions()

doc = DocumentManager.Instance.CurrentDBDocument
uiapp = DocumentManager.Instance.CurrentUIApplication
app = uiapp.Application
uidoc = DocumentManager.Instance.CurrentUIApplication.ActiveUIDocument

def flatten(*args):
	for x in args:
		if hasattr(x, '__iter__'):
			for y in flatten(*x): yield y
		else: yield x


#Credits Archi-lab
def checkParameter(param):
	for p in param:
		internal = p.Definition
		if internal.BuiltInParameter != BuiltInParameter.INVALID:
			return p
	return param[0]

def GetParaValue(params):
	paravalue = []
	p = checkParameter(params)
	if p.StorageType == StorageType.String:
		paravalue.append(p.AsString())
	elif p.StorageType == StorageType.ElementId:
		paravalue.append(p.AsValueString())
	elif p.StorageType == StorageType.Integer:
		paravalue.append(p.AsValueString())
	else:
		paravalue.append(None)
	return paravalue

if isinstance(IN[0], list):
	file = IN[0]
	filename = IN[2]
else:
	file = [IN[0]]
	filename = [IN[2]]

newpath = IN[1]
LinkNames, newdocpath, results, unloadstatus, linkParas = [], [], [], [], []

openConfig = WorksetConfiguration(WorksetConfigurationOption.OpenAllWorksets)
oOptions = OpenOptions()
oOptions.DetachFromCentralOption = DetachFromCentralOption.DetachAndDiscardWorksets
oOptions.Audit = False
oOptions.SetOpenWorksetsConfiguration(openConfig)

worksharingOptions = WorksharingSaveAsOptions()
worksharingOptions.SaveAsCentral = False

SaveOptions = SaveAsOptions()
SaveOptions.MaximumBackups = 1
#SaveOptions.SetWorksharingOptions(worksharingOptions)
SaveOptions.OverwriteExistingFile = True

#rOptions = RelinquishOptions(False)
#rOptions.StandardWorksets = True
#rOptions.ViewWorksets = True
#rOptions.FamilyWorksets = True
#rOptions.UserWorksets = True
#rOptions.CheckedOutElements = True

#sOptions = SynchronizeWithCentralOptions()
#sOptions.SetRelinquishOptions(rOptions)
#sOptions.Compact = True
#sOptions.SaveLocalBefore = True
#sOptions.SaveLocalAfter = True

TransactionManager.Instance.ForceCloseTransaction()

try:
	for files,filenames in zip(file,filename):
		modelpath = FilePath(files)
		newdoc = app.OpenDocumentFile(modelpath,oOptions)
		collector = Autodesk.Revit.DB.FilteredElementCollector(newdoc)
		linkTypes = UnwrapElement(collector.OfClass(Autodesk.Revit.DB.RevitLinkType))
		for linkType in flatten(linkTypes):
			linkPara = linkType.GetParameters("Type Name")
			linkParavalue = GetParaValue(linkPara)
			try:
				linkType.Unload(None)
				unloadstatus.append(True)
			except Exception,e:
				unloadstatus.append(str(e))
			results = [unloadstatus]		
		newfilepath = newpath + "\\" + str(filenames)
		newdoc.SaveAs(newfilepath,SaveOptions)			
		#newdoc.SynchronizeWithCentral(tOptions,sOptions)
		newdoc.Close(True)
		newdocpath.append(newfilepath) 
		OUT = [newdocpath , results]
except Exception,e:
	OUT = str(e)
# ----------------------------------------
watch = Watch(input_rfa_families)
python_script_3 = Python()  # frozen; unwired: IN[0]
# ---------- python_script_3.python (54 lines) ----------
import clr
clr.AddReference('ProtoGeometry')
from Autodesk.DesignScript.Geometry import *

# Import RevitAPI
clr.AddReference("RevitAPI")
import Autodesk
from Autodesk.Revit.DB import *
from Autodesk.Revit.Attributes import*

import clr
clr.AddReference("RevitAPIUI")
from  Autodesk.Revit.UI import *

# Import DocumentManager and TransactionManager
clr.AddReference("RevitServices")
import RevitServices
from RevitServices.Persistence import DocumentManager
from RevitServices.Transactions import TransactionManager

from System.Collections.Generic import *

# Import Revit Nodes
clr.AddReference("RevitNodes")
import Revit
clr.ImportExtensions(Revit.Elements)
clr.ImportExtensions(Revit.GeometryConversion)

# Import python library
import sys
pyt_path = r'C:\Program Files (x86)\IronPython 2.7\Lib'
sys.path.append(pyt_path)
import os

tOptions = TransactWithCentralOptions()

doc = DocumentManager.Instance.CurrentDBDocument
uiapp = DocumentManager.Instance.CurrentUIApplication
app = uiapp.Application
uidoc = DocumentManager.Instance.CurrentUIApplication.ActiveUIDocument

allViews = []
collector = Autodesk.Revit.DB.FilteredElementCollector(doc)
viewCollector = collector.OfClass(View).ToElements()
allViews.append(viewCollector)

params = doc.FamilyManager.GetParameters()
pDef = []
fParam = []
for p in params:
	pDef.append(p.Definition.Name)
	
	
OUT = [allViews, params, doc.FamilyManager.Types]
# ----------------------------------------
output_fbx_families = Directory("D:\Xavier\SUMMONIDEA\BLOGGING\summon-family-browser\src\output_families")  # graph input
fileName = FileSystem.FileName(path=getDirectoryContents.files)
output_json = Directory("D:\Xavier\SUMMONIDEA\BLOGGING\summon-family-browser\src")  # graph input
export_fbx_and_family_parameters = Python(IN[0]=flatten, IN[1]=output_fbx_families, IN[2]=fileName, IN[3]=output_json)
# ---------- export_fbx_and_family_parameters.python (195 lines) ----------
import clr
clr.AddReference('ProtoGeometry')
from Autodesk.DesignScript.Geometry import *

# Import RevitAPI
clr.AddReference("RevitAPI")
import Autodesk
from Autodesk.Revit.DB import *
from Autodesk.Revit.Attributes import*

clr.AddReference("RevitAPIUI")
from  Autodesk.Revit.UI import *

# Import DocumentManager and TransactionManager
clr.AddReference("RevitServices")
import RevitServices
from RevitServices.Persistence import DocumentManager
from RevitServices.Transactions import TransactionManager

from System.Collections.Generic import *

# Import Revit Nodes
clr.AddReference("RevitNodes")
import Revit
clr.ImportExtensions(Revit.Elements)
clr.ImportExtensions(Revit.GeometryConversion)

# Import python library
import sys
pyt_path = r'C:\Program Files (x86)\IronPython 2.7\Lib'
sys.path.append(pyt_path)
import os
import json

tOptions = TransactWithCentralOptions()

doc = DocumentManager.Instance.CurrentDBDocument
uiapp = DocumentManager.Instance.CurrentUIApplication
app = uiapp.Application
#uidoc = DocumentManager.Instance.CurrentUIApplication.ActiveUIDocument

if isinstance(IN[0], list):
	file = IN[0]
	filename = IN[2]
else:
	file = [IN[0]]
	filename = [IN[2]]

exportPath = IN[1]
jsonexportPath = IN[3]

newdocpath = []
types, params, paramValues = [], [], []

openConfig = WorksetConfiguration(WorksetConfigurationOption.OpenAllWorksets)
oOptions = OpenOptions()
oOptions.DetachFromCentralOption = DetachFromCentralOption.DetachAndDiscardWorksets
oOptions.Audit = False
oOptions.SetOpenWorksetsConfiguration(openConfig)

worksharingOptions = WorksharingSaveAsOptions()
worksharingOptions.SaveAsCentral = False

SaveOptions = SaveAsOptions()
SaveOptions.MaximumBackups = 1
SaveOptions.OverwriteExistingFile = True

famLib = {}
famLib['families'] = []

#TransactionManager.Instance.ForceCloseTransaction()

try:
	for files,filenames in zip(file,filename):
		modelpath = FilePath(files)
		newdoc = app.OpenDocumentFile(modelpath, oOptions)
		

				
		
		collector = Autodesk.Revit.DB.FilteredElementCollector(newdoc)
		docViews = collector.OfClass(Autodesk.Revit.DB.View3D).ToElements()
	
		viewSetExport = ViewSet()
		viewSetExport.Insert(docViews[0])
		exportFBX = newdoc.Export(exportPath, filenames, viewSetExport, FBXExportOptions())
		
		#viewListExport = List[Autodesk.Revit.DB.ElementId]()
		#viewListExport.Add(docViews[0].Id)
		#exportDWG = newdoc.Export(newpath, filenames, viewListExport, DWGExportOptions())
		famManager = newdoc.FamilyManager
		
		famParams = newdoc.FamilyManager.GetParameters()
		params.append([p.Definition.Name for p in famParams])
		
		famTypes = newdoc.FamilyManager.Types
		types.append(famTypes)
		
		famTypeParamValues = []
		
		famLib['families'].append({
			'family_path': files,
			'family_name': newdoc.Title,
			'types': [],
			
		})		

		
		for famType in famTypes:
			tp = []
			famLib['families'][-1]['types'].append({
				'type_name': famType.Name,
				'parameters': [],
			})
			#fam = famLib['families'][-1]
			#fam['types'].append(famType.Name)
			
			for famParam in famParams:
				if famParam.StorageType == StorageType.Double:
					tp.append(famType.AsDouble(famParam))
					#famLib['families'][-1]['types'][-1]['parameters'][-1][famParam.Definition.Name] = famType.AsDouble(famParam)
					famLib['families'][-1]['types'][-1]['parameters'].append({
						'parameter_name': famParam.Definition.Name,
						'parameter_group': LabelUtils.GetLabelFor(famParam.Definition.ParameterGroup),
						'parameter_type': LabelUtils.GetLabelFor(famParam.Definition.ParameterType),
						'parameter_formula': famParam.Formula,
						'is_instance': famParam.IsInstance,
						'is_shared': famParam.IsShared,
						'is_reporting': famParam.IsReporting,
						'display_units': LabelUtils.GetLabelFor(famParam.DisplayUnitType),
						
						'value': famType.AsDouble(famParam)
					})
					continue
				elif famParam.StorageType == StorageType.ElementId:
					tp.append(famType.AsElementId(famParam))
					famLib['families'][-1]['types'][-1]['parameters'].append({
						'parameter_name': famParam.Definition.Name,
						'parameter_group': LabelUtils.GetLabelFor(famParam.Definition.ParameterGroup),
						'parameter_type': LabelUtils.GetLabelFor(famParam.Definition.ParameterType),
						'parameter_formula': famParam.Formula,
						'is_instance': famParam.IsInstance,
						'is_shared': famParam.IsShared,
						'is_reporting': famParam.IsReporting,
						#'display_units': famParam.DisplayUnitType.ToString(),
						
						'value': famType.AsElementId(famParam).ToString()
					})
					continue
				elif famParam.StorageType == StorageType.Integer:
					tp.append(famType.AsInteger(famParam))
					famLib['families'][-1]['types'][-1]['parameters'].append({
						'parameter_name': famParam.Definition.Name,
						'parameter_group': LabelUtils.GetLabelFor(famParam.Definition.ParameterGroup),
						'parameter_type': LabelUtils.GetLabelFor(famParam.Definition.ParameterType),
						'parameter_formula': famParam.Formula,
						'is_instance': famParam.IsInstance,
						'is_shared': famParam.IsShared,
						'is_reporting': famParam.IsReporting,
						#'display_units': famParam.DisplayUnitType.ToString(),
						
						'value': famType.AsInteger(famParam)
					})
					continue
				elif famParam.StorageType == StorageType.String:
					tp.append(famType.AsString(famParam))
					famLib['families'][-1]['types'][-1]['parameters'].append({
						'parameter_name': famParam.Definition.Name,
						'parameter_group': LabelUtils.GetLabelFor(famParam.Definition.ParameterGroup),
						'parameter_type': LabelUtils.GetLabelFor(famParam.Definition.ParameterType),
						'parameter_formula': famParam.Formula,
						'is_instance': famParam.IsInstance,
						'is_shared': famParam.IsShared,
						'is_reporting': famParam.IsReporting,
						#'display_units': famParam.DisplayUnitType.ToString(),
						
						'value': famType.AsString(famParam)
					})
					continue
			famTypeParamValues.append(tp)
		
		paramValues.append(famTypeParamValues)		
		
		newFamPath = exportPath + "\\" + str(filenames)
		newdocpath.append(newFamPath)
		
		#newdoc.SaveAs(newfilepath,SaveOptions)	
		newdoc.Close(False)
	#with open('D:\data.json', 'w') as outfile:
	with open(jsonexportPath + '\\family_data.json', 'w') as outfile:
		json.dump(famLib, outfile)
		
	OUT = [newdocpath, types, params, paramValues]
except Exception, e:
	OUT = str(e)
# ----------------------------------------
watch_2 = Watch(export_fbx_and_family_parameters)
code_block_2 = CodeBlock(e=export_fbx_and_family_parameters) { e[3]; }  # frozen
name = Element.Name(element=code_block_2)  # frozen
code_block_3 = CodeBlock(f=flatten) { f[2]; }
code_block_4 = CodeBlock(f=fileName) { f[2]; }
